% Simulink data dictionary hopping_daisy_dd.sldd

COUNTER_INCR = Simulink.Parameter(1, StorageClass="Const", HeaderFile="vga_control.vh", DataType="fixdt(0,10,0)")
COUNTER_ZERO = Simulink.Parameter(0, StorageClass="Const", HeaderFile="vga_control.vh", DataType="fixdt(0,10,0)")
DAISY_HEIGHT = Simulink.Parameter(40, StorageClass="Const", HeaderFile="vga_control.vh", DataType="fixdt(0,10,0)")
DAISY_JUMP_TIMER = Simulink.Parameter(20, StorageClass="Const", HeaderFile="vga_control.vh", DataType="uint8")
DAISY_WIDTH = Simulink.Parameter(40, StorageClass="Const", HeaderFile="vga_control.vh", DataType="fixdt(0,10,0)")
DAISY_X_START = Simulink.Parameter(80, StorageClass="Const", HeaderFile="vga_control.vh", DataType="fixdt(0,10,0)")
DAISY_Y_MAX = Simulink.Parameter(204, StorageClass="Const", HeaderFile="vga_control.vh", DataType="fixdt(0,10,0)")
DAISY_Y_SPEED_MAX = Simulink.Parameter(12, StorageClass="Const", HeaderFile="vga_control.vh", DataType="fixdt(0,10,0)")
DAISY_Y_SPEED_NORM = Simulink.Parameter(6, StorageClass="Const", HeaderFile="vga_control.vh", DataType="fixdt(0,10,0)")
DAISY_Y_START = Simulink.Parameter(360, StorageClass="Const", HeaderFile="vga_control.vh", DataType="fixdt(0,10,0)")
GAME_INIT = Simulink.Parameter(1, StorageClass="Const", DataType="fixdt(0,3,0)")
GAME_OVER = Simulink.Parameter(4, StorageClass="Const", DataType="fixdt(0,3,0)")
GAME_STARTED = Simulink.Parameter(3, StorageClass="Const", DataType="fixdt(0,3,0)")
GAME_WAIT_START = Simulink.Parameter(2, StorageClass="Const", DataType="fixdt(0,3,0)")
GROUND_BLUE = Simulink.Parameter(64, StorageClass="Const", HeaderFile="vga_control.vh", DataType="uint8")
GROUND_GREEN = Simulink.Parameter(176, StorageClass="Const", HeaderFile="vga_control.vh", DataType="uint8")
GROUND_RED = Simulink.Parameter(48, StorageClass="Const", HeaderFile="vga_control.vh", DataType="uint8")
GROUND_Y_START = Simulink.Parameter(400, StorageClass="Const", HeaderFile="vga_control.vh", DataType="fixdt(0,10,0)")
H_BACK = Simulink.Parameter(48, StorageClass="Const", HeaderFile="vga_control.vh", DataType="fixdt(0,10,0)")
H_FRONT = Simulink.Parameter(16, StorageClass="Const", HeaderFile="vga_control.vh", DataType="fixdt(0,10,0)")
H_SYNC = Simulink.Parameter(96, StorageClass="Const", HeaderFile="vga_control.vh", DataType="fixdt(0,10,0)")
H_SYNC_END = Simulink.Parameter(752, StorageClass="Const", DataType="fixdt(0,10,0)")  % H_SYNC_START + H_SYNC
H_SYNC_START = Simulink.Parameter(656, StorageClass="Const", DataType="fixdt(0,10,0)")  % H_VISIBLE + H_FRONT
H_TOTAL = Simulink.Parameter(800, StorageClass="Const", DataType="fixdt(0,10,0)")  % "H_VISIBLE + H_FRONT + H_SYNC + H_BACK"
H_VISIBLE = Simulink.Parameter(640, StorageClass="Const", HeaderFile="vga_control.vh", DataType="fixdt(0,10,0)")
OBSTACLE_BLUE = Simulink.Parameter(64, StorageClass="Const", HeaderFile="vga_control.vh", DataType="uint8")
OBSTACLE_GREEN = Simulink.Parameter(176, StorageClass="Const", HeaderFile="vga_control.vh", DataType="uint8")
OBSTACLE_HEIGHT = Simulink.Parameter(40, StorageClass="Const", HeaderFile="vga_control.vh", DataType="fixdt(0,10,0)")
OBSTACLE_RED = Simulink.Parameter(48, StorageClass="Const", HeaderFile="vga_control.vh", DataType="uint8")
OBSTACLE_WIDTH = Simulink.Parameter(20, StorageClass="Const", HeaderFile="vga_control.vh", DataType="fixdt(0,10,0)")
OBSTACLE_X_SPEED = Simulink.Parameter(4, StorageClass="Const", HeaderFile="vga_control.vh", DataType="fixdt(0,10,0)")
OBSTACLE_X_START = Simulink.Parameter(640, StorageClass="Const", HeaderFile="vga_control.vh", DataType="fixdt(0,10,0)")
OBSTACLE_Y_START = Simulink.Parameter(360, StorageClass="Const", HeaderFile="vga_control.vh", DataType="fixdt(0,10,0)")
SKY_BLUE = Simulink.Parameter(255, StorageClass="Const", HeaderFile="vga_control.vh", DataType="uint8")
SKY_GREEN = Simulink.Parameter(128, StorageClass="Const", HeaderFile="vga_control.vh", DataType="uint8")
SKY_RED = Simulink.Parameter(0, StorageClass="Const", HeaderFile="vga_control.vh", DataType="uint8")
SYNC_N_DEFAULT = Simulink.Parameter(0, StorageClass="Const", HeaderFile="vga_control.vh", DataType="boolean")
V_BACK = Simulink.Parameter(33, StorageClass="Const", HeaderFile="vga_control.vh", DataType="fixdt(0,10,0)")
V_FRONT = Simulink.Parameter(10, StorageClass="Const", HeaderFile="vga_control.vh", DataType="fixdt(0,10,0)")
V_SYNC = Simulink.Parameter(2, StorageClass="Const", HeaderFile="vga_control.vh", DataType="fixdt(0,10,0)")
V_SYNC_END = Simulink.Parameter(492, StorageClass="Const", DataType="fixdt(0,10,0)")  % V_SYNC_START + V_SYNC
V_SYNC_START = Simulink.Parameter(490, StorageClass="Const", DataType="fixdt(0,10,0)")  % V_VISIBLE + V_FRONT
V_TOTAL = Simulink.Parameter(525, StorageClass="Const", DataType="fixdt(0,10,0)")  % "V_VISIBLE + V_FRONT + V_SYNC + V_BACK"
V_VISIBLE = Simulink.Parameter(480, StorageClass="Const", HeaderFile="vga_control.vh", DataType="fixdt(0,10,0)")

daisy_bitmap = uint32([0 0 0 0 0 0 0 0 0 0 0 0 0 0 0 0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
 0 0 0 0 0 0 0 0 0 0 0 0 0 0 0 0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
 0 0 0 0 0 0 0 0 0 0 0 0 0 0 0 0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
 0 0 0 0 0 0 0 0 0 0 0 0 0 0 0 0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
 0 0 0 0 0 0 0 0 0 0 0 0 0 0 0 0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
 0 0 0 0 0 0 0 0 0 0 0 0 0 0 0 0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
 0 0 0 0 0 0 0 0 0 0 0 0 0 0 0 0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
 0 0 0 0 0 0 0 0 0 0 0 0 0 0 0 0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
 0 0 0 0 0 0 0 0 0 0 0 0 0 0 0 0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
 0 0 0 0 0 0 0 0 0 0 0 0 0 0 0 0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 ])

obstacle_bitmap = uint32([4278190080 4278190080 0 0 0 0 0 0 0 0 0 0 0 0 0 0 0 0 4278190080 4278190080
 4278190080 4278190080 4278190080 4278190080 4278190080 4278190080 4278190080 4278190080 4278190080 4278190080 4278190080 4278190080 4278190080 4278190080 4278190080 4278190080 4278190080 4278190080 4278190080 4278190080
 4278190080 4278190080 4278190080 4278190080 4278190080 4278190080 4278190080 4278190080 4278190080 4278190080 4278190080 4278190080 4278190080 4278190080 4278190080 4278190080 4278190080 4278190080 4278190080 4278190080
 4278190080 4278190080 4278190080 0 0 4278190080 4278190080 0 0 4278190080 4278190080 0 0 4278190080 4278190080 0 0 4278190080 4278190080 4278190080
 4278190080 4278190080 4278190080 0 0 4278190080 4278190080 0 0 4278190080 4278190080 0 0 4278190080 4278190080 0 0 4278190080 4278190080 4278190080
 4278190080 4278190080 4278190080 0 0 4278190080 4278190080 0 0 4278190080 4278190080 0 0 4278190080 4278190080 0 0 4278190080 4278190080 4278190080
 4278190080 4278190080 4278190080 4278190080 4278190080 4278190080 4278190080 4278190080 4278190080 4278190080 4278190080 4278190080 4278190080 4278190080 4278190080 4278190080 4278190080 4278190080 4278190080 4278190080
 4278190080 4278190080 4278190080 4278190080 4278190080 4278190080 4278190080 4278190080 4278190080 4278190080 4278190080 4278190080 4278190080 4278190080 4278190080 4278190080 4278190080 4278190080 4278190080 4278190080
 4278190080 4278190080 4278190080 0 0 4278190080 4278190080 0 0 4278190080 4278190080 0 0 4278190080 4278190080 0 0 4278190080 4278190080 4278190080
 4278190080 4278190080 4278190080 0 0 4278190080 4278190080 0 0 4278190080 4278190080 0 0 4278190080 4278190080 0 0 4278190080 4278190080 4278190080
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 ])