% Simulink data dictionary hopping_daisy_dd.sldd

COUNTER_INCR = Simulink.Parameter(1, StorageClass="Define", HeaderFile="vga_control.vh", DataType="fixdt(0,10,0)")
COUNTER_ZERO = Simulink.Parameter(0, StorageClass="Define", HeaderFile="vga_control.vh", DataType="fixdt(0,10,0)")
H_BACK = Simulink.Parameter(48, StorageClass="Define", HeaderFile="vga_control.vh", DataType="fixdt(0,10,0)")
H_FRONT = Simulink.Parameter(16, StorageClass="Define", HeaderFile="vga_control.vh", DataType="fixdt(0,10,0)")
H_SYNC = Simulink.Parameter(96, StorageClass="Define", HeaderFile="vga_control.vh", DataType="fixdt(0,10,0)")
H_SYNC_END = Simulink.Parameter(752, StorageClass="Define", DataType="fixdt(0,10,0)")  % H_SYNC_START + H_SYNC
H_SYNC_START = Simulink.Parameter(656, StorageClass="Define")  % H_VISIBLE + H_FRONT
H_TOTAL = Simulink.Parameter(800, StorageClass="Define", DataType="fixdt(0,10,0)")  % "H_VISIBLE + H_FRONT + H_SYNC + H_BACK"
H_VISIBLE = Simulink.Parameter(640, StorageClass="Define", HeaderFile="vga_control.vh", DataType="fixdt(0,10,0)")
MODE_INIT = Simulink.Parameter(1, DataType="fixdt(0,2,0)")
MODE_RESET = Simulink.Parameter(0, DataType="fixdt(0,2,0)")
MODE_STARTED = Simulink.Parameter(2, DataType="fixdt(0,2,0)")
MODE_STOPPED = Simulink.Parameter(3, DataType="fixdt(0,2,0)")
SYNC_N_DEFAULT = Simulink.Parameter(0, StorageClass="Define", HeaderFile="vga_control.vh", DataType="boolean")
V_BACK = Simulink.Parameter(33, StorageClass="Define", HeaderFile="vga_control.vh", DataType="fixdt(0,10,0)")
V_FRONT = Simulink.Parameter(10, StorageClass="Define", HeaderFile="vga_control.vh", DataType="fixdt(0,10,0)")
V_SYNC = Simulink.Parameter(2, StorageClass="Define", HeaderFile="vga_control.vh", DataType="fixdt(0,10,0)")
V_SYNC_END = Simulink.Parameter(492, StorageClass="Define", DataType="fixdt(0,10,0)")  % V_SYNC_START + V_SYNC
V_SYNC_START = Simulink.Parameter(490, StorageClass="Define", DataType="fixdt(0,10,0)")  % V_VISIBLE + V_FRONT
V_TOTAL = Simulink.Parameter(525, StorageClass="Define", DataType="fixdt(0,10,0)")  % "V_VISIBLE + V_FRONT + V_SYNC + V_BACK"
V_VISIBLE = Simulink.Parameter(480, StorageClass="Define", HeaderFile="vga_control.vh", DataType="fixdt(0,10,0)")